test file "DelayModel"

suite "New Test Suite 1"

  case "Delays Testing" [baseline]
    model MPC3DoF
    parameter set "Parameter Set 1": controller_type = ControllerType.CasADi  % model workspace
    iteration script:
      %% Iterate over various delay times
      %%increment most likely by 0.1 seconds.
      delay = 0.1:0.2:2;


      % Create each iteration
      for d = 1 : numel(delay)
          % Set up a new iteration object
          testItr = sltestiteration();

          delay_table = delay(d);
              % Set iteration settings
          setVariable(testItr,'Name','optimization_time','Source','model workspace', 'Value', delay_table);

              % Register the iteration to run in this test case
          addIteration(sltest_testCase, testItr, sprintf("Delay_%.3f", delay(d)));

      end