test file "MismodelingModel"

suite "Tests"

  case "Mismodeling Model" [baseline]
    description: Testing rates (max_throttle_rate, max_gimbal_rate) as well as com, inertia, and mass errors affect controller performance.
    model MPC3DoF
    parameter set "Parameter Set 1":
      com_error = 0  % model workspace
      inertia_error = 0  % model workspace
      mass_error = 0  % model workspace
      max_gimbal_rate = 1  % model workspace
      max_throttle_rate = 0.05  % model workspace